# Grasshopper definition L05_0.gh (Grasshopper 1.0.7)
# plug-ins: LunchBox, Pufferfish

radius = GetNumber(Slider(5, range=0..10), AtLeast=1, AtMost=1, Maximum=1.797693135e+308, Minimum=-1.797693135e+308)
sphere = Sphere(Base=PlaneXY(0, 0, 0), Radius=radius)
braced_grid_1_d_structure = BracedGrid1DStructure(Surface=sphere, UDivisions=10, VDivisions=10)  # -> PrimaryLines, BraceLines, StructureNodes
parameter_pipe_mesh = ParameterPipeMesh(
    Curve=braced_grid_1_d_structure.PrimaryLines,
    Radius=Slider(0.1, range=0..0.1),
    ParametersU=[0, 0.1, 0.2, 0.3, 0.4, 0.5, 0.6, 0.7, 0.8, 0.9, 1],
    ParametersV=[0, 0.25, 0.5, 0.75, 1],
    Weighted=False,
    Lengths=False,
    Angle=0,
    Rotation=0,
    EndType=0,
    Triangulate=False)
context_bake = ContextBake(Geometry=parameter_pipe_mesh)
